# Dynamo graph LayoutTests.dyn (Dynamo 2.13.1.3887)
# packages: Camber 4.0.0

current = Autodesk.AutoCAD.DynamoNodes.Document.Current()
string = StringInput("Layout1")
getLayoutByName = Camber.AutoCAD.Layout.GetLayoutByName(document=current, name=string)
setName = Camber.AutoCAD.Layout.SetName(layout=getLayoutByName)  # unwired: newName
string_2 = StringInput("Layout3")
getActiveLayout = Camber.AutoCAD.Layout.GetActiveLayout(document=current)
block = Camber.AutoCAD.Layout.Block(layout=getActiveLayout)
boolean = BoolSelector(true)
getLayouts = Camber.AutoCAD.Layout.GetLayouts(document=current, includeModel=boolean)
tabOrder = Camber.AutoCAD.Layout.TabOrder(layout=getLayouts)
name = Camber.AutoCAD.Layout.Name(layout=getLayoutByName)
